# Grasshopper definition Classify_1_generate_training_set.ghx (Grasshopper 0.9.76)
# plug-ins: Python Interpreter, Kangaroo Components, Boid, LunchBox, Weaverbird

# ---- group: Iterate/Seed
toggle = BooleanToggle(True)
timer = Timer(TimerInterval=100, Target=counter)  # disabled
counter = Counter(Reset=toggle)
panel = Panel(counter)

# ----
number_of_voxels_per_side = Slider(10, range=0..10)

# ---- group: Generate Geometry
num = Number(counter)
dom = ConstructDomain(DomainStart=Slider(1, range=0..10), DomainEnd=Slider(9, range=0..10))
random = Random(Range=dom, Number=1, Seed=num)
rndvec = RandomVector(Number=1, Unit=False, RandomSeed=num, AbsoluteMultiplier=1)
random_2 = Random(Range=dom, Number=1, Seed=random)
pl = PlaneNormal(Origin=Point(0, 0, 0), ZAxis=rndvec)
random_3 = Random(Range=dom, Number=1, Seed=random_2)
platotetra = PlatonicTetrahedron(Plane=PlaneXY(0, 0, 0), Radius=random, Truncation=0)
sph = Sphere(Base=PlaneXY(0, 0, 0), Radius=random_3)
box = DomainBox(Base=PlaneXY(0, 0, 0), X=random_3, Y=random_2, Z=random)

pt = ConstructPoint(XCoordinate=0, YCoordinate=0, ZCoordinate=random_2)
wbprism = WeaverbirdsMeshPrism(
    Plane=PlaneXY(0, 0, 0),
    Width=random,
    NumberOfSides=Slider(24, range=0..100),
    TopPoint=pt,
    BasePolygonMethod=True,
    FillStrategy=1)

num_2 = Number(expr("x/2", random))
box_2 = CenterBox(Base=PlaneXY(0, 0, 0), X=num_2, Y=num_2, Z=num_2)

cyl = Cylinder(Base=PlaneXY(0, 0, 0), Radius=num_2, Length=random_2)
cap = CapHoles(Brep=cyl)

cone = Cone(Base=PlaneXY(0, 0, 0), Radius=num_2, Length=random_2)  # -> Cone, Tip
cap_2 = CapHoles(Brep=cone.Cone)

orient = Orient(Geometry=wbprism, Source=PlaneXY(0, 0, 0), Target=pl)  # -> Geometry, Transform

# ---- group: Voxelization
geo = Geometry(orient.Geometry)
smallest_cube_around_object = Smallest_Cube_Around_Object(C=geo)  # -> geo_2, num_2
make_points_from_box = Make_Points_From_Box(geo=smallest_cube_around_object.geo_2, num=number_of_voxels_per_side)  # -> G, dimension_of_cube_2
inclusion_test = Inclusion_test(geo=geo, geo_3=make_points_from_box.G)  # -> bool_2, geo_6
geo_2 = Geometry(inclusion_test.geo_6)

# ---- group: Write to File
panel_2 = Panel("C:\Users\provolot\Dropbox\_Projects\2016 Projects\GangGang\tmp-transfer\1.0_Classify\")
num_3 = Number(counter)
concat = Concatenate(FragmentA=panel_2, FragmentB="testtest")
bool = Boolean(toggle)
int = Integer(inclusion_test.bool_2)
not = GateNot(A=bool)
write_data_as_json_ish = PythonScript(Activate=not, Filename=concat, Sample_Num=num_3, Data_1D=int)  # -> out; inputs Activate: Boolean, Data_1D: list of Int32
# ---------- write_data_as_json_ish: Python ----------
import json

from collections import OrderedDict

if Activate:
    
    with open(Filename, "a") as myfile:
        obj = OrderedDict([('sample_num', Sample_Num), 
                              ('data', Data_1D)])
        line = json.dumps(obj, sort_keys = False) + ",\n"
        print line
        myfile.write(line)
# ---------- end write_data_as_json_ish ----------
panel_3 = Panel(write_data_as_json_ish)

# ---- group: representation
num_4 = Number(make_points_from_box.dimension_of_cube_2)
xy = XYPlane(Origin=Point(0, 0, 0))
number_slider = Slider(1, range=0..1)
box_3 = DomainBox(Base=xy, X=num_4, Y=num_4, Z=num_4)
mbox = MeshBox(Base=box_3, XCount=number_slider, YCount=number_slider, ZCount=number_slider)
orient_2 = Orient(Geometry=mbox, Source=xy, Target=inclusion_test.geo_6)  # -> Geometry, Transform
clean = CleanTree(RemoveNulls=True, RemoveInvalid=True, RemoveEmpty=False, Tree=orient_2.Geometry)
geo_3 = Geometry(clean)
medges = MeshEdges(Mesh=geo_3)  # -> NakedEdges, InteriorEdges, NonManifoldEdges
preview = CustomPreview(
    Geometry=[medges.NakedEdges, medges.InteriorEdges, medges.NonManifoldEdges, geo_3],
    Shader=ColourSwatch(SwatchColor=RGBA(62, 31, 255, 57)))

# ==== cluster Smallest_Cube_Around_Object
C = ClusterInput()
bbox = BoundingBox(Content=C, Plane=PlaneXY(0, 0, 0))  # -> Box, Box_2
debox = DeconstructBox(Box=bbox.Box)  # -> Plane, X, Y, Z
bnd = Bounds(Numbers=[debox.Z, debox.X, debox.Y])
dedomain = DeconstructDomain(Domain=bnd)  # -> Start, End
volume = Volume(Geometry=bbox.Box)  # -> Volume, Centroid
division = Division(A=dedomain.End, B="2")
box = CenterBox(Base=volume.Centroid, X=division, Y=division, Z=division)
geo = Geometry(box)
num = Number(dedomain.End)
geo_2 = ClusterOutput(geo)
num_2 = ClusterOutput(num)

# ==== cluster Make_Points_From_Box
geo = ClusterInput()
debox = DeconstructBox(Box=geo)  # -> Plane, X, Y, Z
num = ClusterInput()
num_2 = Number(debox.X)
num_3 = Number(num)
lowerleftpoint = LowerLeftPoint(geo=geo)
division = Division(A=num_2, B=num_3)
division_2 = Division(A=division, B="2")
num_4 = Number(division_2)
num_5 = Number(division_2)
vec = VectorXYZ(XComponent=num_4, YComponent=num_4, ZComponent=num_4)  # -> Vector, Length
dimension_of_cube = Number(division)
move = Move(Geometry=lowerleftpoint, Motion=vec.Vector)  # -> Geometry, Transform
box = CenterBox(Base=lowerleftpoint, X=num_5, Y=num_5, Z=num_5)
dimension_of_cube_2 = ClusterOutput(dimension_of_cube)
arrbox = BoxArray(Geometry=move.Geometry, Cell=box, XCount=num_3, YCount=num_3, ZCount=num_3)  # -> Geometry, Transform
G = ClusterOutput(arrbox.Geometry)

# ==== cluster Inclusion_test
geo = ClusterInput()
geo_2 = Geometry(geo)
geo_3 = ClusterInput()
mesh = MeshBrep(
    Brep=geo_2,
    Settings={GridMaxCount=0, GridMinCount=16, JaggedSeams=False, MaxEdgeLength=0, MinEdgeLength=0.0001, MinTolerance=0, Refine=True, RefineAngle=0, RelativeTolerance=0.65, SimplePlanes=True, Tolerance=0})
geo_4 = Geometry(geo_3)
ma = MassAddition(Input=mesh)  # -> Result, PartialResults
filter = StreamFilter(Gate=ma.Result, Stream0=geo_2, Stream1=mesh)
minc = MeshInclusion(Mesh=filter, Point=geo_4, Strict=False)
sift = SiftPattern(List=geo_4, SiftPattern=minc)  # -> Output0, Output1
bool = Boolean(minc)
geo_5 = Geometry(sift.Output1)
bool_2 = ClusterOutput(bool)
geo_6 = ClusterOutput(geo_5)

# ==== cluster LowerLeftPoint
geo = ClusterInput()
geo_2 = Geometry(geo)
bbox = BoundingBox(Content=geo_2, Plane=PlaneXY(0, 0, 0), UnionBox=True)  # -> Box, Box_2
debrep = DeconstructBrep(Brep=bbox.Box)  # -> Faces, Edges, Vertices
sort_pt = SortPoints(Points=debrep.Vertices)  # -> Points, Indices
item = ListItem(List=sort_pt.Points, Index=0, Wrap=True)
pt = Geometry(item)
pt_2 = ClusterOutput(pt)
