# Grasshopper definition Classify_3_voxelize_and_send.ghx (Grasshopper 0.9.76)
# plug-ins: Python Interpreter, HDTReference

predict = Button()
getselectedgeo = GetSelectedGeo(reset=predict)
rec = DataRecorder(getselectedgeo, DataLimit=1, RecordData=True)

# ---- group: This is a constant and should not be changed, unless the model changes.
number_of_voxels_per_side = Slider(10, range=0..10)

# ---- group: Voxelization
geo = Geometry(rec)
smallest_cube_around_object = Smallest_Cube_Around_Object(C=geo)  # -> geo_2, num_2
make_points_from_box = Make_Points_From_Box(geo=smallest_cube_around_object.geo_2, num=number_of_voxels_per_side)  # -> G, dimension_of_cube_2
inclusion_test = Inclusion_test(geo=geo, geo_3=make_points_from_box.G)  # -> bool_2, geo_6
geo_2 = Geometry(inclusion_test.geo_6)

# ---- group: Get data from other script with GangGang
int = Integer(inclusion_test.bool_2)
dam = DataDam(DataA=int, BufferDelay=2500000, BufferMode=2)
ganggang_client = PythonScript(Activate=Toggle(True), Host="172.16.15.1", Port="9093", Data=dam)  # -> Result, StatKeys, StatValues, Prediction; inputs Port: Int32, Data: list
# ---------- ganggang_client: Python ----------
import GangGang

if (Activate):
    result = GangGang.client(Host, Port, Data)
    
    print result
    print type(result)
    StatKeys = result['stats'].keys()
    StatValues = result['stats'].values()
    Prediction = result['prediction']
    Result = str(result)
# ---------- end ganggang_client ----------

# ----
md_slider = MDSlider(
    slider_value=Point(0.5457406393, 0.1592169971, 0.5),
    SliderMode=0,
    x_domain=Domain(-1, 1),
    y_domain=Domain(-1, 1),
    z_domain=Domain(0, 1))
data = Data(ganggang_client.StatKeys)
lng = ListLength(List=data)
series = Series(Start=0, Step=Slider(29.3, range=0..60), Count=lng)
multiplication = Multiplication(A=md_slider, B=Slider(252, range=0..300))
vec = VectorXYZ(XComponent=0, YComponent=series, ZComponent=0)  # -> Vector, Length
move = Move(Geometry=multiplication, Motion=vec.Vector)  # -> Geometry, Transform
texttoscreen = RenderTextToScreen(
    Text=data,
    Location=move.Geometry,
    Size=Slider(17, range=0..100),
    Color=ColourSwatch(SwatchColor=RGB(163, 44, 255)),
    m_scWithvp=False)

md_slider_2 = MDSlider(
    slider_value=Point(0.2317073171, 0.4951219326, 0.5),
    SliderMode=0,
    x_domain=Domain(0, 1),
    y_domain=Domain(0, 1),
    z_domain=Domain(0, 1))
panel = Panel("""GH -> Keras (Tensorflow) -> GH
Machine Learning 
object classification proof-of-concept
@dantaeyoung 160612""")
multiplication_2 = Multiplication(A=md_slider_2, B=Slider(100, range=0..100))
texttoscreen_2 = RenderTextToScreen(
    Text=panel,
    Location=multiplication_2,
    Size=Slider(16, range=0..100),
    Color=ColourSwatch(SwatchColor=RGB(11, 7, 0)),
    Font="Arial",
    m_scWithvp=False)

python = PythonScript(data=ganggang_client.StatValues)  # -> out, a
# ---------- python: Python ----------
print data

a = "{:.8f}".format(data) + "%"
# ---------- end python ----------
md_slider_3 = MDSlider(
    slider_value=Point(0.8487816787, 0.3270216221, 0.5),
    SliderMode=0,
    x_domain=Domain(-1, 1),
    y_domain=Domain(-1, 1),
    z_domain=Domain(0, 1))
data_2 = Data(python.a)
lng_2 = ListLength(List=data_2)
series_2 = Series(Start=0, Step=Slider(29.3, range=0..60), Count=lng_2)
multiplication_3 = Multiplication(A=md_slider_3, B=Slider(500, range=0..500))
vec_2 = VectorXYZ(XComponent=0, YComponent=series_2, ZComponent=0)  # -> Vector, Length
move_2 = Move(Geometry=multiplication_3, Motion=vec_2.Vector)  # -> Geometry, Transform
texttoscreen_3 = RenderTextToScreen(
    Text=data_2,
    Location=move_2.Geometry,
    Size=Slider(13, range=0..100),
    Color=ColourSwatch(SwatchColor=RGB(163, 44, 255)),
    m_scWithvp=False)

data_3 = Data(ganggang_client.StatValues)
lng_3 = ListLength(List=data_3)
dom = ConstructDomain(DomainStart=Slider(0.1, range=0..100), DomainEnd=Slider(20, range=0..100))
series_3 = Series(Start=0, Step=Slider(-3.1, range=-10..11), Count=lng_3)
remap = RemapNumbers(Value=data_3, Source=Domain(0, 1), Target=dom)  # -> Mapped, Clipped
pt = ConstructPoint(XCoordinate=0, YCoordinate=series_3, ZCoordinate=0)
X = UnitX(Factor=1)
md_slider_4 = MDSlider(
    slider_value=Point(0.7478697242, 0.2244562289, 0.5),
    SliderMode=0,
    x_domain=Domain(-1, 1),
    y_domain=Domain(-1, 1),
    z_domain=Domain(0, 1))
gradient = Gradient(LowerLimit=0, UpperLimit=1, Parameter=data_3, stops=[0: RGB(0, 4, 80), 1: RGB(236, 38, 211)])
line = LineSDL(Start=pt, Direction=X, Length=remap.Mapped)
boxnotpipe_straightlines = BoxNotPipe_STRAIGHTLINES(geo=line, num=Slider(1, range=0..10))
multiplication_4 = Multiplication(A=md_slider_4, B=Slider(300, range=0..300))
meshtoscreen = RenderMeshToScreen(
    Mesh=boxnotpipe_straightlines,
    Location=multiplication_4,
    ScaleFactor=Slider(9.4, range=0..100),
    Color=gradient,
    Depth=0.95,
    Fixed=True,
    m_scWithvp=False)

X_2 = UnitX(Factor=Slider(37, range=0..100))

# ---- group: representation
num = Number(expr("x/2", make_points_from_box.dimension_of_cube_2))
xy = XYPlane(Origin=Point(0, 0, 0))
number_slider = Slider(1, range=0..1)
swatch = ColourSwatch(SwatchColor=RGBA(62, 31, 255, 57))

# ----
box = CenterBox(Base=xy, X=num, Y=num, Z=num)
col = Colour(swatch)

# ---- group: representation (continued)
mbox = MeshBox(Base=box, XCount=number_slider, YCount=number_slider, ZCount=number_slider)
orient = Orient(Geometry=mbox, Source=xy, Target=geo_2)  # -> Geometry, Transform
clean = CleanTree(RemoveNulls=True, RemoveInvalid=True, RemoveEmpty=False, Tree=orient.Geometry)

# ----
move_3 = Move(Geometry=clean, Motion=X_2)  # -> Geometry, Transform

# ---- group: representation (continued)
geo_3 = Geometry(move_3.Geometry)
medges = MeshEdges(Mesh=geo_3)  # -> NakedEdges, InteriorEdges, NonManifoldEdges
preview = CustomPreview(Geometry=[medges.NakedEdges, medges.InteriorEdges, medges.NonManifoldEdges, geo_3], Shader=col)

# ==== cluster Smallest_Cube_Around_Object
C = ClusterInput()
bbox = BoundingBox(Content=C, Plane=PlaneXY(0, 0, 0))  # -> Box, Box_2
debox = DeconstructBox(Box=bbox.Box)  # -> Plane, X, Y, Z
bnd = Bounds(Numbers=[debox.Z, debox.X, debox.Y])
dedomain = DeconstructDomain(Domain=bnd)  # -> Start, End
volume = Volume(Geometry=bbox.Box)  # -> Volume, Centroid
division = Division(A=dedomain.End, B="2")
box = CenterBox(Base=volume.Centroid, X=division, Y=division, Z=division)
geo = Geometry(box)
num = Number(dedomain.End)
geo_2 = ClusterOutput(geo)
num_2 = ClusterOutput(num)

# ==== cluster Make_Points_From_Box
geo = ClusterInput()
debox = DeconstructBox(Box=geo)  # -> Plane, X, Y, Z
num = ClusterInput()
num_2 = Number(debox.X)
num_3 = Number(num)
lowerleftpoint = LowerLeftPoint(geo=geo)
division = Division(A=num_2, B=num_3)
division_2 = Division(A=division, B="2")
num_4 = Number(division_2)
num_5 = Number(division_2)
vec = VectorXYZ(XComponent=num_4, YComponent=num_4, ZComponent=num_4)  # -> Vector, Length
dimension_of_cube = Number(division)
move = Move(Geometry=lowerleftpoint, Motion=vec.Vector)  # -> Geometry, Transform
box = CenterBox(Base=lowerleftpoint, X=num_5, Y=num_5, Z=num_5)
dimension_of_cube_2 = ClusterOutput(dimension_of_cube)
arrbox = BoxArray(Geometry=move.Geometry, Cell=box, XCount=num_3, YCount=num_3, ZCount=num_3)  # -> Geometry, Transform
G = ClusterOutput(arrbox.Geometry)

# ==== cluster Inclusion_test
geo = ClusterInput()
geo_2 = Geometry(geo)
geo_3 = ClusterInput()
mesh = MeshBrep(
    Brep=geo_2,
    Settings={GridMaxCount=0, GridMinCount=16, JaggedSeams=False, MaxEdgeLength=0, MinEdgeLength=0.0001, MinTolerance=0, Refine=True, RefineAngle=0, RelativeTolerance=0.65, SimplePlanes=True, Tolerance=0})
geo_4 = Geometry(geo_3)
null = NullItem(Item=mesh)  # -> NullFlags, InvalidFlags, Description
filter = StreamFilter(Gate=null.NullFlags, Stream0=mesh, Stream1=geo_2)
minc = MeshInclusion(Mesh=filter, Point=geo_4, Strict=False)
panel = Panel(minc)
sift = SiftPattern(List=geo_4, SiftPattern=minc)  # -> Output0, Output1
bool = Boolean(minc)
geo_5 = Geometry(sift.Output1)
bool_2 = ClusterOutput(bool)
geo_6 = ClusterOutput(geo_5)

# ==== cluster BoxNotPipe_STRAIGHTLINES
num = ClusterInput()
geo = ClusterInput()
num_2 = Number(num)
geo_2 = Geometry(geo)
end = EndPoints(Curve=geo_2)  # -> Start, End
neg = Negative(Value=num_2)
pl = PlaneNormal(Origin=end.Start, ZAxis=geo_2)
len = Length(Curve=geo_2)
dom = ConstructDomain(DomainStart=neg, DomainEnd=num_2)
box = DomainBox(Base=pl, X=dom, Y=dom, Z=len)
B = ClusterOutput(box)

# ==== cluster GetSelectedGeo
reset = ClusterInput()
selobj = ObjectsBySelection(Reset=reset)  # -> SelectedGeometry, ObjectAttributes
sortbytype = SortObjectsByType(RhinoObjects=selobj.SelectedGeometry)  # -> Points, Curves, Surfaces, Breps, Meshes, TextObjects, HatchObjects, LightObjects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
geo = Geometry([sortbytype.Breps, sortbytype.Extrusions])
geo_2 = ClusterOutput(geo)

# ==== cluster LowerLeftPoint
geo = ClusterInput()
geo_2 = Geometry(geo)
bbox = BoundingBox(Content=geo_2, Plane=PlaneXY(0, 0, 0), UnionBox=True)  # -> Box, Box_2
debrep = DeconstructBrep(Brep=bbox.Box)  # -> Faces, Edges, Vertices
sort_pt = SortPoints(Points=debrep.Vertices)  # -> Points, Indices
item = ListItem(List=sort_pt.Points, Index=0, Wrap=True)
pt = Geometry(item)
pt_2 = ClusterOutput(pt)
